vi "DC Voltage.gvi"   [LabVIEW NXG 5.1.0]
panel controls:
  "DONE": bool
  "ZATWIERDZ": bool
  "Manual Range": f64 = "1 V"(1)
  "Auto Range": bool = TRUE
  "Auto Zero": bool = TRUE
  "DCV Ratio": bool
  "Auto Impedance": bool
  "Aperture NPLC": f64 = "10 PLC"(10)
  "Aperture Time": f64 = 0.1
  "Aperture": bool = TRUE
  "DIG Option On/Off": bool
panel indicators:
  "resulting string": string
  "Auto Zero_2": bool
  "DCV Ratio_2": bool
  "Auto Impedance_2": bool
  "Manual Range_2": f64
  "Aperture NPLC_2": f64
  "Aperture Time_2": f64
  "name": string
uses:
  Agilent 3446X Series::Configure Measurement.gvi
  Agilent 3446X Series::Configure Measurement Aperture.gvi
  Agilent 3446X Series::Configure Voltage.gvi
  Agilent 3446X Series::Auto Zero.gvi
diagram:
  while {
    $"Auto Zero_2" <- $"Auto Zero"
    Quotient And Remainder(x=$"Aperture Time", y=2e-06) -> (floor(x/y)=w1, x-y*floor(x/y)=w2)
    Multiply(w2, 1000000) -> w3
    Round To Nearest(number=w3) -> w4
    To Signed 32 Bit Integer(number=w4) -> w5
    case (w5) {
      frame 0, Default {
        Multiply(2e-06, w1) -> w6
      }
      frame 1 {
        Multiply(2e-06, w1) -> w6
      }
      frame 2 {
        Add(1, w1) -> w7
        Multiply(2e-06, w7) -> w6
      }
    }
    case ($ZATWIERDZ) {
      frame False, Default {
        w8 = FALSE
      }
      frame True {
        case ($"Auto Zero") {
          frame False, Default {
            w9 = "Auto Zero: Off"
          }
          frame True {
            w9 = "Auto Zero: On"
          }
        }
        case ($Aperture) {
          frame False, Default {
            Format Into String(formatString="%_6ps", initString="Aperture Time: ", w6) -> w10
          }
          frame True {
            Format Into String(formatString="%#gPLC", initString="Aperture NPLC: ", $"Aperture NPLC") -> w10
          }
        }
        case ($"Auto Range") {
          frame False, Default {
            Format Into String(formatString="%.0pV", initString="Range: ", $"Manual Range") -> w11
          }
          frame True {
            w11 = "Range: Auto"
          }
        }
        case ($"DCV Ratio") {
          frame False, Default {
            w12 = "DCV Ratio: Off"
          }
          frame True {
            w12 = "DCV Ratio: On"
          }
        }
        case ($"Auto Impedance") {
          frame False, Default {
            w13 = "Input Z: 10MΩ"
          }
          frame True {
            w13 = "Input Z: Auto"
          }
        }
        Concatenate Strings("Your settings:", "\r\n", w11, "\r\n", w10, "\r\n", w9, "\r\n", w13, "\r\n", w12, "\r\n", "Are you sure you want to change settings?") -> w14
        Two Button Dialog(message=w14) -> (T Button?=w8)
      }
    }
    case (w8) {
      frame False, Default { }
      frame True {
        call "Configure Measurement.gvi"(VISA resource name="TCPIP0::A-34461A-0000-2.local::inst0::INSTR", measurement function="Voltage DC"(10)) -> (VISA resource name out=w15, error out=w16)
        case ($Aperture) {
          frame False, Default {
            call "Configure Measurement Aperture.gvi"(VISA resource name=w15, error in=w16, measurement function="Voltage DC"(10), enable aperture=TRUE, aperture time=w6) -> (VISA resource name out=w19, error out=w20)
            call "Configure Voltage.gvi"(VISA resource name=w19, error in=w20) -> (VISA resource name out=w17, error out=w18)
          }
          frame True {
            call "Configure Measurement Aperture.gvi"(VISA resource name=w15, error in=w16, measurement function="Voltage DC"(10), enable aperture=FALSE) -> (VISA resource name out=w21, error out=w22)
            call "Configure Voltage.gvi"(VISA resource name=w21, error in=w22, voltage integration time=$"Aperture NPLC") -> (VISA resource name out=w17, error out=w18)
          }
        }
        case ($"Auto Range") {
          frame False, Default {
            call "Configure Measurement.gvi"(manual range=$"Manual Range", VISA resource name=w17, error in=w18, measurement function="Voltage DC"(10), auto range=FALSE) -> (VISA resource name out=w23, error out=w24)
          }
          frame True {
            call "Configure Measurement.gvi"(VISA resource name=w17, error in=w18, measurement function="Voltage DC"(10), auto range=TRUE) -> (VISA resource name out=w23, error out=w24)
          }
        }
        case ($"Auto Zero") {
          frame False, Default {
            call "Auto Zero.gvi"(VISA resource name=w23, error in=w24, zero type="Voltage DC"(3), auto zero="Disable"(0)) -> (VISA resource name out=w25, error out=w26)
          }
          frame True {
            call "Auto Zero.gvi"(VISA resource name=w23, error in=w24, zero type="Voltage DC"(3), auto zero="Enable"(1)) -> (VISA resource name out=w25, error out=w26)
          }
        }
        case ($"Auto Impedance") {
          frame False, Default {
            call "Configure Voltage.gvi"(VISA resource name=w25, error in=w26, auto impedance=FALSE) -> (VISA resource name out=w27, error out=w28)
          }
          frame True {
            call "Configure Voltage.gvi"(VISA resource name=w25, error in=w26, auto impedance=TRUE) -> (VISA resource name out=w29, error out=w30)
          }
        }
      }
    }
    case ($"DIG Option On/Off") {
      frame False, Default {
        w31 = [0, 1, 2]
      }
      frame True {
        w31 = i32[] []
      }
    }
    Property Node(instance in=reference to "Aperture NPLC", "DisabledIndexes"=w31)
    Not(x=$Aperture) -> w32
    Property Node(instance in=reference to "Aperture NPLC", "Disabled"=w32)
    $"Aperture NPLC_2" <- $"Aperture NPLC"
    case ($"DIG Option On/Off") {
      frame False, Default {
        w33 = 0.0002
      }
      frame True {
        w33 = 2e-05
      }
    }
    Property Node(instance in=reference to "Aperture Time", "Minimum"=w33)
    Property Node(instance in=reference to "Aperture Time", "Disabled"=$Aperture)
    $"Aperture Time_2" <- $"Aperture Time"
    Format Into String(formatString="%_6ps", initString="The Aperture Time has been set to: ", w6) -> w34
    $"resulting string" <- w34
    Property Node(instance in=reference to "Manual Range", "Disabled"=$"Auto Range")
    $"Manual Range_2" <- $"Manual Range"
    $"DCV Ratio_2" <- $"DCV Ratio"
    $"Auto Impedance_2" <- $"Auto Impedance"
    stop if $DONE
  }
